# Grasshopper definition Neil_8Points.gh (Grasshopper 1.0.7)
# plug-ins: Weaverbird, Super Delaunay 2d, Wallacei

wlc_neil_gene = GenePool(Decimals=2, Maximum=50, Minimum=0, Value=[19.55164577, 25, 25, 25, 25, 25])
number_slider = Slider(6, range=0..20)
pt = Point([Point(28.22862591, 118.7449761, 0), Point(37.94665626, 107.5225363, 0), Point(38.1185835, 113.3391104, 0), Point(48.11976616, 106.6817931, 0), Point(40.2804601, 92.02603863, 0), Point(28.6338541, 91.83473117, 0)])
geo = Geometry(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)
gene_pool_and_slider_shuffler = GenePoolAndSliderShuffler(BooleanButton=Button())
lng = ListLength(List=pt)
define_points = GetPoint(pt, AtLeast=1, AtMost=20, Prompt="Define Points", Realtime=True)
set_bounding_geometry = GetGeometry(geo, AtLeast=1, AtMost=1, DeleteInput=False, Filter=1073741828)
set_different_weights = GetNumber(
    wlc_neil_gene,
    AtLeast=8,
    AtMost=8,
    Maximum=1.797693135e+308,
    Minimum=-1.797693135e+308,
    Prompt="Set Different Weights 0 to 20")
set_radius = GetNumber(Slider(0.5, range=0..1), AtLeast=1, AtMost=1, Maximum=1, Minimum=0.1, Prompt="Set Radius")
set_division_factor = GetNumber(Slider(1.5, range=0..2), AtLeast=1, AtMost=1, Maximum=2, Minimum=0.1, Prompt="Set Division Factor")
vb = VBScript(genelist="wlc_Neil_Gene", count=lng)  # -> out, A
# ---------- vb: VB usings ----------
Imports System.IO
Imports System.Linq
Imports System.Data
Imports System.Drawing
Imports System.Reflection
Imports System.Windows.Forms
Imports System.Xml
Imports System.Xml.Linq
Imports Microsoft.VisualBasic
Imports System.Runtime.InteropServices

Imports Rhino.DocObjects
Imports Rhino.Collections
Imports GH_IO
Imports GH_IO.Serialization
# ---------- vb: VB ----------
    For Each obj As IGH_DocumentObject In owner.OnPingDocument().Objects
      If (obj.ComponentGuid <> New Guid("{21553c44-ea62-475e-a8bb-62b2a3ee5ca5}")) Then Continue For
      If (obj.NickName Like genelist) Then
        CallByName(obj, "Count", CallType.Set, count)
        'CallByName(obj, "ExpireSolution", CallType.Method, False)
        Return
      End If
    Next

    Print("No matching Gene list object found")
# ---------- end vb ----------
panel = Panel(set_different_weights)
delaunay = Delaunay(
    Points=define_points,
    Weights=set_different_weights,
    Radius=set_radius,
    DivisionFactor=set_division_factor,
    DelaunayOutputMode=4)  # -> Delaunay, ThickenerPrimal, ThickenerPrimalTopology
delaunay_2 = Delaunay(
    PreexistingDelaunay=delaunay.Delaunay,
    Bounds=set_bounding_geometry,
    Radius=set_radius,
    DivisionFactor=set_division_factor,
    DelaunayInputMode=2,
    DelaunayOutputMode=5)  # -> Delaunay, ThickenerDual, ThickenerDualTopology
list = ValueList({"One": 1, "Two": 2, "Three": 2² - 1, "Zero": 0}, selected="One")
wbcatmullclark = WeaverbirdsCatmullClarkSubdivision(MeshCurves=delaunay_2.ThickenerDual, Level=list, SmoothNakedEdges=1)
mesh = Mesh(wbcatmullclark)
context_bake = ContextBake(Geometry=mesh)
